# Grasshopper definition assignment-01.gh (Grasshopper 1.0.8)

d = Slider(9, range=1..50)
w = Slider(40, range=1..50)
h = Slider(22, range=0..30)
d_2 = Slider(19, range=1..30)
h_2 = Slider(31, range=1..50)
r = Slider(5, range=1..20)
stairs_corner = Point(Point(50, 20, 0))
w_2 = Slider(70, range=1..100)
h_3 = Slider(23, range=1..100)
# Assignment-01: Bauhaus
path = FilePath("/Users/stefaniebretting/workspace/cdf1_teaching/src/")
tower_center = Point(Point(20, 30, 0))
gate_corner = Point(Point(10, 0, 0))
autoreloader = Python3Script(src_path=path)  # -> out; inputs src_path: String
# ---------- autoreloader: Python ----------
#! python3
import sys, os, time
import scriptcontext as sc
import Rhino, System
from System.IO import FileSystemWatcher, NotifyFilters

VERSION = 1  
pkg = "cdf"

if not src_path:
    raise Exception("Connect a folder to src_path.")
path = os.path.normpath(src_path)
watch_dir = os.path.join(path, pkg)
if not os.path.isdir(watch_dir):
    raise Exception("No '{}' folder found in:\n{}".format(pkg, path))

def unload():
    for name in list(sys.modules):
        if name == pkg or name.startswith(pkg + "."):
            del sys.modules[name]

# Put this folder first in Python's search list
if path in sys.path:
    sys.path.remove(path)
sys.path.insert(0, path)

key = "cdf_watcher_" + str(ghenv.Component.InstanceGuid)
time_key = key + "_time"
version_key = key + "_version"

def stamp():
    sc.sticky[time_key] = time.strftime("%Y-%m-%d %H:%M:%S")

# Replace the old watcher if the folder changed or the script was updated
old = sc.sticky.get(key)
if old is not None and (os.path.normpath(old.Path) != watch_dir
                        or sc.sticky.get(version_key) != VERSION):
    old.Dispose()
    del sc.sticky[key]
    unload()

if key not in sc.sticky:
    comp = ghenv.Component
    last = [0.0]

    def reload_and_rerun():
        unload()
        stamp()
        doc = comp.OnPingDocument()
        if doc is None:            # reloader was deleted or the file closed
            return
        for obj in doc.Objects:
            if "Python" in obj.GetType().Name:
                obj.ExpireSolution(False)   # mark as out of date
        doc.NewSolution(False)              # recompute once

    def on_change(sender, e):
        if not e.FullPath.endswith(".py") or "__pycache__" in e.FullPath:
            return
        if time.time() - last[0] < 0.5:     # ignore the second event of a double save
            return
        last[0] = time.time()
        Rhino.RhinoApp.InvokeOnUiThread(System.Action(reload_and_rerun))

    w = FileSystemWatcher(watch_dir, "*.py")
    w.IncludeSubdirectories = True
    w.NotifyFilter = NotifyFilters.LastWrite
    w.Changed += on_change
    w.EnableRaisingEvents = True
    sc.sticky[key] = w
    sc.sticky[version_key] = VERSION
    stamp()                                  # time the watcher started

msg = "Last reloaded: {}\nWatching: {}".format(sc.sticky.get(time_key, "unknown"), watch_dir)
print(msg)
out = msg
# ---------- end autoreloader ----------
gate_corner_2 = Point(Point(30, 0, 0))
gate_corner_3 = Point(Point(50, 0, 0))
origin = Point(Point(0, 0, 0))
cylinder_cone = Python3Script(center=tower_center, height=h_2, radius=r)  # -> tower; inputs center: Point3d
# ---------- cylinder_cone: Python ----------
# import function
import Rhino.Geometry as rg
from cdf import create_cylinder, create_cone, rotate, boolean_union

# create components
wall = create_cylinder(base_point=center, height=height-5, radius=radius)
roof = create_cone(base_point=center+rg.Point3d(0, 0, height-5), height=5, radius=radius)
roof = rotate(brep=roof, angle_degrees=180, axis_point=center+rg.Point3d(0, 0, height-2.5), axis_direction="x")

# create tower
tower = boolean_union(brep_a=wall, brep_b=roof)
# ---------- end cylinder_cone ----------
box = Python3Script(corner=stairs_corner, width=w, depth=d_2, height=h)  # -> stairs; inputs corner: Point3d, width: Int32, depth: Int32, height: Int32
# ---------- box: Python ----------
# import function
import Rhino.Geometry as rg 
from cdf import create_box, boolean_union

# first step
# create list for boolean union to extend
steps = [create_box(base_point=corner, width=width, height=2, depth=depth)]

# call function
for i in range(int(height / 2)):
    corner = corner + rg.Vector3d(0, 2, 2)
    depth -= 2
    if depth <= 0:
        break
    #step = create_box(base_point=corner, width=width, height=2, depth=depth)
    #stairs = boolean_union(brep_a=stairs[i], brep_b=step)
    base = rg.Point3d(corner.X, corner.Y, 0)
    steps.append(create_box(base_point=base, width=width, height=corner.Z + 2, depth=depth))

stairs = rg.Brep.CreateBooleanUnion(steps, 0.001)
# ---------- end box ----------
cylinder = Python3Script(corner=gate_corner_3, height=d)  # -> gateway; inputs corner: Point3d
# ---------- cylinder: Python ----------
# import function
import Rhino.Geometry as rg
from cdf import create_cylinder, rotate, translate

# create cylinder
gateway = create_cylinder(height=height, radius=5)

# rotate cylinder
gateway = rotate(brep=gateway, angle_degrees=90, axis_direction="x")

# translate cylinder
gateway = translate(brep=gateway, translation_vector=corner+rg.Point3d(5, height, 15))
# ---------- end cylinder ----------
cylinder_2 = Python3Script(corner=gate_corner_2, height=d)  # -> gateway; inputs corner: Point3d; same code as cylinder
box_2 = Python3Script(corner=origin, width=w_2, height=h_3, depth=d)  # -> base_box; inputs corner: Point3d
# ---------- box_2: Python ----------
# import function
from cdf import create_box

# call function
base_box = create_box(base_point=corner, width=width, height=height, depth=depth)
# ---------- end box_2 ----------
box_3 = Python3Script(corner=gate_corner_3, depth=d)  # -> door; inputs corner: Point3d
# ---------- box_3: Python ----------
# import function
from cdf import create_box

# call function
door = create_box(base_point=corner, width=10, height=15, depth=depth)
# ---------- end box_3 ----------
cylinder_3 = Python3Script(corner=gate_corner, height=d)  # -> gateway; inputs corner: Point3d; same code as cylinder
box_4 = Python3Script(corner=gate_corner_2, depth=d)  # -> door; inputs corner: Point3d; same code as box_3
box_5 = Python3Script(corner=gate_corner, depth=d)  # -> door; inputs corner: Point3d; same code as box_3
panel = Panel(autoreloader)

# ---- group: Visualize
preview = CustomPreview(Geometry=cylinder_cone, Material=ColourSwatch(SwatchColor=RGB(27, 44, 88)))

preview_2 = CustomPreview(Geometry=box, Material=ColourSwatch(SwatchColor=RGB(110, 185, 88)))

# ----
union = Python3Script(door=box_5, gateway=cylinder_3)  # -> gate1; inputs door: Brep, gateway: Brep
# ---------- union: Python ----------
from cdf import boolean_union

gate1 = boolean_union(brep_a=door, brep_b=gateway)
# ---------- end union ----------
union_2 = Python3Script(door=box_4, gateway=cylinder_2)  # -> gate2; inputs door: Brep, gateway: Brep
# ---------- union_2: Python ----------
from cdf import boolean_union

gate2 = boolean_union(brep_a=door, brep_b=gateway)
# ---------- end union_2 ----------
union_3 = Python3Script(door=box_3, gateway=cylinder)  # -> gate3; inputs door: Brep, gateway: Brep
# ---------- union_3: Python ----------
from cdf import boolean_union

gate3 = boolean_union(brep_a=door, brep_b=gateway)
# ---------- end union_3 ----------
difference = Python3Script(wall=box_2, gate1=union, gate2=union_2, gate3=union_3)  # -> wall_gates; inputs wall: Brep, gate1: Brep, gate2: Brep, gate3: Brep
# ---------- difference: Python ----------
from cdf import boolean_difference

# boolean_difference returns a list of brep
wall_gates = boolean_difference(brep_a=wall, brep_b=gate1)
wall_gates = boolean_difference(brep_a=wall_gates[0], brep_b=gate2)
wall_gates = boolean_difference(brep_a=wall_gates[0], brep_b=gate3)
# ---------- end difference ----------

# ---- group: Visualize
preview_3 = CustomPreview(Geometry=difference, Material=ColourSwatch(SwatchColor=RGB(194, 34, 88)))
